# Grasshopper definition 200yrPavilion.gh (Grasshopper 1.0.7)

# ---- group: RH_IN:m1top2
number_slider = Slider(0, range=-1000..1000)

# ----
quantities190819edited = Panel("""1x2240x-
1x2300x-
1x2310x-
1x2340x-
1x2360x-
1x2380x-
2x2390x-
1x2400x-
2x2410x-
1x2420x-
1x2430x-
1x2440x-
2x2450x-
1x2510x-
1x2590x-
1x2640x2040
4x2650x-
1x2650x650/2140
1x2660x-
1x2740x-
1x2960x900/1260/1570/1800
1x3070x-
1x3150x-
1x3170x-
1x3180x-
1x3200x360/1860
1x3300x-
1x3310x-
1x3350x-
1x3490x-
1x3490x1700
2x3500x-
2x3540x-
1x3550x-
1x3650x1700
1x3680x-
1x3860x-
1x3980x-
1x3990x1350/2830
1x4160x300/1750/3250
1x4250x-
1x4410x-
1x4580x300/1800/3340
1x5080x-
1x5260x-
1x5340x-
1x5600x-""")

# ---- group: RH_IN:m1top1
number_slider_2 = Slider(0, range=-1000..1000)

# ---- group: RH_IN:m2width
number_slider_3 = Slider(1000, range=-1000..1000)

# ---- group: RH_IN:m2top1
number_slider_4 = Slider(0, range=-1000..1000)

# ---- group: RH_IN:m2top2
number_slider_5 = Slider(0, range=-1000..1000)

# ----
# Execute
# GRAPHIC
# STANDARD
# one-time execution of plugins
size = Panel("119x119")

# ---- group: RH_IN:m3width
number_slider_6 = Slider(0, range=-1000..1000)

# ---- group: RH_IN:m3top1
number_slider_7 = Slider(0, range=-1000..1000)

# ---- group: RH_IN:m3top2
number_slider_8 = Slider(0, range=-1000..1000)

# ---- group: RH_IN:m1width
number_slider_9 = Slider(-1000, range=-1000..1000)

# ----
top = Curve(graft(Tree({0;0;0;0;0}: [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], {0;1;0;0;0}: [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], {0;2;0;0;0}: [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])))
L = Curve(graft([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]))
R = Curve(graft([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]))

size_spacing = Slider(120, range=0..1000)
top_2 = Slider(225, range=0..1000)
botom = Slider(250, range=0..1000)
floor = Slider(220, range=0..1000)
data = Data(size_spacing)
data_2 = Data(top_2)
data_3 = Data(floor)
data_4 = Data(botom)

entwine = Entwine(Branch00=number_slider_9, Branch01=number_slider_3, Branch02=number_slider_6, FlattenInputs=True)
entwine_2 = Entwine(Branch00=number_slider_2, Branch01=number_slider_4, Branch02=number_slider_7, FlattenInputs=True)
entwine_3 = Entwine(Branch00=number_slider, Branch01=number_slider_5, Branch02=number_slider_8, FlattenInputs=True)

dss_annotation_panel = Panel("Mod for RC")
end = EndPoints(Curve=top)  # -> Start, End
X = UnitX(Factor=expr("-x", entwine))
X_2 = UnitX(Factor=entwine)
Z = UnitZ(Factor=entwine_2)
Z_2 = UnitZ(Factor=entwine_3)
move = Move(Geometry=end.Start, Motion=Z)  # -> Geometry, Transform
move_2 = Move(Geometry=end.End, Motion=Z_2)  # -> Geometry, Transform
move_3 = Move(Geometry=R, Motion=X_2)  # -> Geometry, Transform
move_4 = Move(Geometry=L, Motion=X)  # -> Geometry, Transform
ln = Line(StartPoint=move.Geometry, EndPoint=move_2.Geometry)
trim = TrimTree(Tree=ln, Depth=2)
crv = Curve(move_3.Geometry)
crv_2 = Curve(trim)
crv_3 = Curve(move_4.Geometry)

# ----
# Control
# data input and manipulation of parameters
# data from sources external to Rhino
dss_annotation_panel_2 = Panel("Wood Stocks")
split = TextSplit(Text=size, Separators="x")
split_2 = TextSplit(Text=quantities190819edited, Separators="x")
pt = Point(Point(0, 0, 0))
item = ListItem(List=split_2, Index=0, Wrap=True)  # -> simplify(Item), simplify(Item1), simplify(Item2)
item_2 = ListItem(List=split, Index=0, Wrap=True)  # -> Item, Item1
dom = ConstructDomain(DomainStart=expr("-x/2", item_2.Item), DomainEnd=expr("x/2", item_2.Item))
dom_2 = ConstructDomain(DomainStart=expr("-x/2", item_2.Item1), DomainEnd=expr("x/2", item_2.Item1))
dup = DuplicateData(Data=item.Item2, Number=item.Item, Order=True)  # -> simplify(Data)
dup_2 = DuplicateData(Data=item.Item1, Number=item.Item, Order=True)  # -> simplify(Data)
box = DomainBox(Base=PlaneXY(0, 0, 0), X=dom, Y=dom_2, Z=dup_2)  # -> simplify(graft(Box))
lng = ListLength(List=flatten(box))
series = Series(Start=0, Step=150, Count=lng)
xy = XYPlane(Origin=pt)
X_3 = UnitX(Factor=series)
move_5 = Move(Geometry=xy, Motion=X_3)  # -> Geometry, Transform
xy_2 = XYPlane(Origin=Point(0, 0, 0))
orient = Orient(Geometry=box, Source=xy_2, Target=graft(move_5.Geometry))  # -> simplify(Geometry), Transform
S = Data(orient.Geometry)
sli = Data(dup_2)
anm = Data(dup)
H = Data(item_2.Item)

data_5 = Data(data)
data_6 = Data(data_3)
data_7 = Data(data_2)
data_8 = Data(data_4)
crv_4 = Curve(crv)
crv_5 = Curve(crv_2)
crv_6 = Curve(crv_3)
dss_annotation_panel_3 = Panel("Pavilion")
H_2 = Data(H)
X_4 = UnitX(Factor=1)
Z_3 = UnitZ(Factor=1)
divlength = DivideLength(Curve=crv_4, Length=data_5)  # -> Points, Tangents, Parameters
Y = UnitY(Factor=expr("x/2", data_5))
pl = ConstructPlane(Origin=divlength.Points, XAxis=X_4, YAxis=Z_3)
move_6 = Move(Geometry=pl, Motion=Y)  # -> Geometry, Transform
pcx = CurvePlane(Curve=crv_5, Plane=move_6.Geometry)  # -> Points, ParamsC, ParamsP
plx = LinePlane(Line=crv_6, Plane=pl)  # -> Point, ParamL, ParamP
trim_2 = TrimTree(Tree=pcx.Points, Depth=1)
dispatch = Dispatch(List=trim_2, DispatchPattern=[True, False])  # -> ListA, ListB
dispatch_2 = Dispatch(List=plx.Point, DispatchPattern=[True, False])  # -> ListA, ListB
dispatch_3 = Dispatch(List=divlength.Points, DispatchPattern=[True, False])  # -> ListA, ListB
ln_2 = Line(StartPoint=dispatch.ListB, EndPoint=dispatch_2.ListB)
ln_3 = Line(StartPoint=dispatch_3.ListA, EndPoint=dispatch_2.ListA)
ln_4 = Line(StartPoint=dispatch_3.ListB, EndPoint=dispatch.ListA)
cull_i = CullIndex(List=reverse(ln_4), Indices=0, Wrap=True)  # -> reverse(List)
data_9 = Data(ln_3)
ext = ExtendCurve(Curve=data_9, Type=0, Start=data_6, End=data_6)
ext_2 = ExtendCurve(Curve=cull_i, Type=0, Start=data_8, End=data_7)
ext_3 = ExtendCurve(Curve=ln_2, Type=0, Start=data_7, End=data_8)
chop = Chop(data=ext_2)
chop_2 = Chop_2(C=ext_3)
data_10 = Data(simplify(chop))
data_11 = Data(simplify(ext))
data_12 = Data(simplify(chop_2))
merge = Merge(Data1=data_10, Data2=data_12, Data3=data_11)  # -> simplify(Result)
beam = Beam(data=data_10, H=H_2)
beam_2 = Beam(data=data_12, H=H_2)
beam_3 = Beam(data=data_11, H=H_2)
len = Length(Curve=merge)
merge_2 = Merge(Data1=beam, Data2=beam_2, Data3=beam_3)
int = Integer(len)
sort = SortList(Keys=flatten(int), ValuesA=flatten(merge_2), ValuesB=flatten(merge))  # -> Keys, ValuesA, ValuesB
L_2 = Data(sort.Keys)
A = Data(sort.ValuesA)
C = Data(sort.ValuesB)

# ----
# Code
# Reference
# Bake
# Design
# referencing geometry from Rhino
# use dssBake User Object
# Import
# Export
# Segment
# data to sources external to Rhino
# group modules into larger coherent parts
dss_annotation_panel_4 = Panel("default development")

# ----
# Monitor
# Annotation
# scripting components
# and plugin specific modules
# data display and geometry preview
# annotation external to Modules
# External UI
# WIP
# Flow
# external user interfaces
# for instance dssHUI
# problematic or under repair or construction
dss_annotation_panel_5 = Panel("data flow management")

S_2 = Data(flatten(S))
sli_2 = Data(flatten(sli))
anm_2 = Data(flatten(anm))
L_3 = Data(flatten(L_2))
A_2 = Data(flatten(A))
C_2 = Data(flatten(C))
dss_annotation_panel_6 = Panel("Check buildability")
rancol = GhPythonScript(x=sli_2)  # -> a
# ---------- rancol: Python ----------
#Random Color
a="100,100,100"
# ---------- end rancol ----------
col = Colour(rancol)
pystock = GhPythonScript(SLI=flatten(sli_2), SG=flatten(S_2), SC=flatten(col), ANM=flatten(anm_2))  # -> S; inputs SLI: list of Int32, SG: list, SC: list, ANM: list
# ---------- pystock: Python ----------
class Stock:
    def __init__(self,id,sizeMax,geom,c,anm):
        self.sizeMax=sizeMax
        self.id=id
        self.geo=geom
        self.used=0
        self.sizeUsed=0
        self.beamsIds=[]
        self.assigned=False
        self.color=c
        self.anm=anm


stocks=[]
for i,s in enumerate(SLI):
    
    id='s'+str(i)
    x=Stock(id,s,SG[i],SC[i],ANM[i])

    stocks.append(x)


#sort stocks by sizeMax
stocks.sort(key=lambda x: x.sizeMax)


S=stocks
# ---------- end pystock ----------
pybeam = GhPythonScript(BLI=flatten(L_3), BG=flatten(A_2), BCrv=flatten(C_2))  # -> B; inputs BLI: list of Int32, BG: list, BCrv: list
# ---------- pybeam: Python ----------
class Beam:
    def __init__(self,id,size,geom,center):
        self.id=id
        self.size=size
        self.geo=geom
        self.center=center
        self.stockIds=0
        self.assigned=False


beams=[]
for i,s in enumerate(BLI):
    
    id='b'+str(i)
    x=Beam(id,s,BG[i],BCrv[i])
    beams.append(x)


#sort beams by size

beams.sort(key=lambda x: x.size)

B=beams
# ---------- end pybeam ----------
pyassign = GhPythonScript(Stock=pystock, Beam=pybeam)  # -> sOut, bOut; inputs Stock: list, Beam: list
# ---------- pyassign: Python ----------
#sort stocks, bea,s by size, reverse order
Stock.sort(key=lambda x: x.sizeMax, reverse=True)
Beam.sort(key=lambda x: x.size, reverse=True)

for beam in Beam:
    c=0
    i=0
    
    print '----------------'
    print beam.id
    print beam.size
    
    print i==0
    
    stockIndex=None
    
    #rearagne stocks from largest available size
    Stock.sort(key=lambda x: x.sizeMax-x.sizeUsed, reverse=True)
    
    #check stocks
    for i,stock in enumerate(Stock):
        
        print stock.sizeMax-stock.sizeUsed
        
        if beam.size>stock.sizeMax-stock.sizeUsed and i==0:
            beam.stockIds=None
            print 'big/out'
        else:
            if beam.size < stock.sizeMax-stock.sizeUsed:
                stockIndex=i
    
    #assign stock
    if not stockIndex==None:
        beam.stockIds=Stock[stockIndex]
        beam.assigned=True
        
        Stock[stockIndex].sizeUsed=Stock[stockIndex].sizeUsed+beam.size
        Stock[stockIndex].beamsIds.append(beam)
        Stock[stockIndex].assigned=True

Stock.sort(key=lambda x: x.sizeMax, reverse=False)
Beam.sort(key=lambda x: x.size, reverse=False)

sOut=Stock
bOut=Beam
# ---------- end pyassign ----------
S_3 = Data(pyassign.sOut)
B = Data(pyassign.bOut)

dss_annotation_panel_7 = Panel("Output")
S_4 = Data(S_3)
B_2 = Data(B)
pyparsestock = GhPythonScript(x=S_4)  # -> simplify(graft(id)), simplify(graft(sizeMax)), simplify(graft(geo)), simplify(graft(sizeUsed)), simplify(beamIds), simplify(graft(assigned)), simplify(graft(color))
# ---------- pyparsestock: Python ----------
id=x.id
sizeMax=x.sizeMax
geo=x.geo
sizeUsed=x.sizeUsed
beamIds=x.beamsIds
assigned=x.assigned
color=x.color
# ---------- end pyparsestock ----------
pyparsebeam = GhPythonScript(x=B_2)  # -> id, size, geo, center, stockIds, assigned, color
# ---------- pyparsebeam: Python ----------
id=x.id
size=x.size
geo=x.geo
center=x.center
stockIds=x.stockIds
assigned=x.assigned
try:
    color=x.stockIds.color
except:
    color=None
# ---------- end pyparsebeam ----------
dispatch_4 = Dispatch(List=pyparsestock.beamIds, DispatchPattern=pyparsestock.assigned)  # -> ListA, ListB
dispatch_5 = Dispatch(List=pyparsestock.sizeMax, DispatchPattern=pyparsestock.assigned)  # -> ListA, ListB
dispatch_6 = Dispatch(List=pyparsestock.geo, DispatchPattern=pyparsestock.assigned)  # -> ListA, ListB
dispatch_7 = Dispatch(List=pyparsestock.color, DispatchPattern=pyparsestock.assigned)  # -> ListA, ListB
clean = CleanTree(RemoveNulls=True, RemoveInvalid=True, RemoveEmpty=invert(False), Tree=dispatch_4.ListA)
clean_2 = CleanTree(RemoveNulls=True, RemoveInvalid=True, RemoveEmpty=invert(False), Tree=dispatch_5.ListA)
clean_3 = CleanTree(RemoveNulls=True, RemoveInvalid=True, RemoveEmpty=invert(False), Tree=dispatch_6.ListA)
volume = Volume(Geometry=pyparsestock.geo)  # -> Volume, Centroid
pyparsebeam_2 = GhPythonScript(x=clean)  # -> id, size, geo, center, stockIds, assigned
# ---------- pyparsebeam_2: Python ----------
id=x.id
size=x.size
geo=x.geo
center=x.center
stockIds=x.stockIds
assigned=x.assigned
# ---------- end pyparsebeam_2 ----------
dispatch_8 = Dispatch(List=pyparsebeam.geo, DispatchPattern=pyparsebeam.assigned)  # -> ListA, ListB
pdecon = Deconstruct(Point=volume.Centroid)  # -> XComponent, YComponent, ZComponent
ma = MassAddition(Input=pyparsebeam_2.size)  # -> Result, PartialResults
division = Division(A=ma.Result, B=clean_2)
pytag = GhPythonScript(x=S_4)  # -> simplify(graft(t))
# ---------- pytag: Python ----------
try:
    t=x.id + '/' + str(x.sizeUsed) + '/'+ str(x.sizeMax)
    for b in x.beamsIds:
        bt= '-' + b.id + '/' +str(b.size)
        t=t+bt
except:
    t=x.id + '/' + str(x.sizeUsed) + '/'+ str(x.sizeMax)
# ---------- end pytag ----------
pt_2 = ConstructPoint(XCoordinate=pdecon.XComponent, YCoordinate=expr("X+200", pdecon.YComponent), ZCoordinate=0)
eval = EvaluateCurve(Curve=reparameterize(pyparsebeam.center), Parameter=0.5)  # -> Point, Tangent, Angle
pytag_2 = GhPythonScript(x=B_2)  # -> t
# ---------- pytag_2: Python ----------
try:
    t=x.id + '/' + str(x.size) + ' - ' + x.stockIds.id + '/' + str(x.stockIds.sizeMax)
except:
    t=x.id + '/' + str(x.size) + ' - ' + 'None'
# ---------- end pytag_2 ----------
scale_nu = ScaleNU(Geometry=clean_3, Plane=PlaneXY(0, 0, 0), ScaleX=1, ScaleY=1, ScaleZ=division)  # -> Geometry, Transform

# ----
# Format output for Rhino Compute
woodmissing = Geometry(flatten(dispatch_8.ListB))
woodstock = Geometry(flatten(pyparsestock.geo))
woodused = Geometry(flatten(scale_nu.Geometry))
taglamella = Text(flatten(pytag_2))
woodok = Geometry(flatten(dispatch_8.ListA))
ptlamella = Point(flatten(eval.Point))
tagstock = Text(flatten(pytag))
ptstock = Point(flatten(pt_2))
mat = GhPythonScript(x=woodused)  # -> a
# ---------- mat: Python ----------
if not x == None:
    a="Wood"
# ---------- end mat ----------
mat_2 = GhPythonScript(x=woodstock)  # -> a
# ---------- mat_2: Python ----------
if not x == None:
    a="Transparent"
# ---------- end mat_2 ----------
mat_3 = GhPythonScript(x=woodok)  # -> a; same code as mat
mat_4 = GhPythonScript(x=woodmissing)  # -> a
# ---------- mat_4: Python ----------
if not x == None:
    a="WoodMissing"
# ---------- end mat_4 ----------
merge_3 = Merge(Data1=tagstock, Data2=taglamella)
merge_4 = Merge(Data1=ptstock, Data2=ptlamella)
merge_5 = Merge(Data1=mat, Data2=mat_2, Data3=mat_3, Data4=mat_4)
clean_4 = CleanTree(RemoveNulls=True, RemoveInvalid=True, RemoveEmpty=False, Tree=merge_5)

volume_2 = Volume(Geometry=woodstock)  # -> Volume, Centroid
scale_nu_2 = ScaleNU(Geometry=woodstock, Plane=volume_2.Centroid, ScaleX=1.1, ScaleY=1.1, ScaleZ=1.01)  # -> Geometry, Transform
smesh = SimpleMesh(Brep=scale_nu_2.Geometry)

merge_6 = Merge(Data1=woodused, Data2=smesh, Data3=woodok, Data4=woodmissing)
clean_5 = CleanTree(RemoveNulls=True, RemoveInvalid=True, RemoveEmpty=False, Tree=merge_6)

txt = Text(merge_3)
txt_2 = Text(clean_4)
mesh = Mesh(clean_5)
pt_3 = Point(merge_4)

# ---- group: RH_OUT:Mesh
mesh_2 = Mesh(mesh)

# ---- group: RH_OUT:Material
txt_3 = Text(txt_2)

# ---- group: RH_OUT:Text
txt_4 = Text(txt)

# ---- group: RH_OUT:TextPt
pt_4 = Point(pt_3)

# ==== cluster Chop
data = ClusterInput()
data_2 = Data(simplify(data))
end = EndPoints(Curve=data_2)  # -> flatten(Start), End
pdecon = Deconstruct(Point=flatten(end.Start))  # -> XComponent, YComponent, ZComponent
sort = SortList(Keys=pdecon.ZComponent, ValuesA=end.Start)  # -> Keys, ValuesA
item = ListItem(List=reverse(sort.ValuesA), Index=0, Wrap=True)
xy = XYPlane(Origin=item)
pcx = CurvePlane(Curve=data_2, Plane=xy)  # -> Points, simplify(ParamsC), ParamsP
trim = TrimTree(Tree=pcx.ParamsC, Depth=1)
shatter = Shatter(Curve=graft(data_2), Parameters=graft(trim))
item_2 = ListItem(List=reverse(shatter), Index=0, Wrap=True)  # -> simplify(Item)
trim_2 = TrimTree(Tree=item_2, Depth=1)
T = ClusterOutput(trim_2)

# ==== cluster Chop_2
C = ClusterInput()
flip = FlipCurve(Curve=C)  # -> Curve, Flag
data = Data(simplify(flip.Curve))
end = EndPoints(Curve=data)  # -> flatten(Start), End
pdecon = Deconstruct(Point=flatten(end.Start))  # -> XComponent, YComponent, ZComponent
sort = SortList(Keys=pdecon.ZComponent, ValuesA=end.Start)  # -> Keys, ValuesA
item = ListItem(List=reverse(sort.ValuesA), Index=0, Wrap=True)
xy = XYPlane(Origin=item)
pcx = CurvePlane(Curve=data, Plane=xy)  # -> Points, simplify(ParamsC), ParamsP
trim = TrimTree(Tree=pcx.ParamsC, Depth=1)
shatter = Shatter(Curve=graft(data), Parameters=graft(trim))
item_2 = ListItem(List=reverse(shatter), Index=0, Wrap=True)  # -> simplify(Item)
trim_2 = TrimTree(Tree=item_2, Depth=1)
T = ClusterOutput(trim_2)

# ==== cluster Beam
data = ClusterInput()
H = ClusterInput()
data_2 = Data(simplify(graft(data)))
H_2 = Data(H)
eval = EvaluateCurve(Curve=reparameterize(data_2), Parameter=0)  # -> Point, Tangent, Angle
eval_2 = EvaluateCurve(Curve=reparameterize(data_2), Parameter=1)  # -> Point, Tangent, Angle
dom = ConstructDomain(DomainStart=expr("-x/2", H_2), DomainEnd=expr("x/2", H_2))
pl = PlaneNormal(Origin=eval.Point, ZAxis=eval.Tangent)
pl_2 = PlaneNormal(Origin=eval_2.Point, ZAxis=eval_2.Tangent)
rectangle = Rectangle(Plane=pl_2, XSize=dom, YSize=dom, Radius=0)  # -> Rectangle, Length
rectangle_2 = Rectangle(Plane=pl, XSize=dom, YSize=dom, Radius=0)  # -> Rectangle, Length
loft = Loft(
    Curves=[rectangle.Rectangle, rectangle_2.Rectangle],
    Options={Adjust=False, Closed=False, LoftEnds=0, LoftSimp=0, LoftType=0, Rebuild=10, Refit=0.01})
cap = CapHoles(Brep=loft)
trim = TrimTree(Tree=cap, Depth=1)
T = ClusterOutput(trim)
