# Grasshopper definition slider-model.gh (Grasshopper 1.0.7)

# ---- group: RH_IN:Building_Type
building_type = ValueList({"Multiple Floors Building": 0, "Single Floor Building": 1}, selected="Multiple Floors Building")

# ---- group: RH_IN:Typical_Floor_Height
typical_floor_height = Slider(3000, range=2500..20000)

# ---- group: RH_IN:Options
options = ValueList({"Option 01": 0, "Option 02": 1, "Option 03": 2, "Option 04": 3, "Option 05": 4, "Option 06": 5}, selected="Option 04")

# ---- group: RH_IN:Ground_Floor_Height
ground_floor_height = Slider(5000, range=2500..20000)

# ----
brep = Brep([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])

# ---- group: RH_IN:Ribs_1st_Dim
ribs_1st_dimension = Slider(20, range=0..20000)

# ---- group: RH_IN:Randomness_Seed
randomness_seed = Slider(20, range=0..1000)

# ---- group: RH_IN:Slab_Thickness
slab_thickness = Slider(200, range=0..5000)

# ---- group: RH_IN:Ribs_2nd_Dim
ribs_2nd_dimension = Slider(300, range=10..20000)

# ---- group: RH_IN:Ribs_Position
ribs_position = Slider(0, range=-10000..10000)

# ---- group: RH_IN:Glass_Thickness
glass_thickness = Slider(50, range=0..10000)

# ---- group: RH_IN:Ribs_Spacing
ribbs_spacing = Slider(500, range=100..20000)

# ---- group: RH_IN:Inner_Walls_Distribution
inner_walls_distribution = ValueList({"Dynamic": 0, "Typical": 1}, selected="Dynamic")

# ---- group: RH_IN:Maximum_Room_Width
maximum_room_width = Slider(5000, range=500..20000)

# ---- group: RH_IN:Glass_Position
glass_position = Slider(500, range=0..10000)

# ---- group: RH_IN:Minimum_Room_Width
minimum_room_width = Slider(2500, range=500..20000)

# ----
list_item = ListItem(List=brep, Index=options, Wrap=True)
typical_floor_height_2 = Data(typical_floor_height)
ground_floor_height_2 = Data(ground_floor_height)
building_type_2 = Data(building_type)
ribs_1st_dimension_2 = Data(ribs_1st_dimension)
ribs_2nd_dimension_2 = Data(ribs_2nd_dimension)
inner_walls_distribution_2 = Data(inner_walls_distribution)
randomness_seed_2 = Data(randomness_seed)
slab_thickness_2 = Data(slab_thickness)
maximum_room_width_2 = Data(maximum_room_width)
minimum_room_width_2 = Data(minimum_room_width)
glass_thickness_2 = Data(glass_thickness)
ribs_position_2 = Data(ribs_position)
# In
# Out
brep_2 = Data(list_item)
ribbs_spacing_2 = Data(ribbs_spacing)
glass_position_2 = Data(glass_position)
brep_3 = Data(brep_2)
building_type_3 = Data(building_type_2)

# ---- group: Single / Multiple Floors
stream_gate = StreamGate(Stream=brep_3, Gate=building_type_3)  # -> Target0, Target1

# ----
ground_floor_height_3 = Data(ground_floor_height_2)
typical_floor_height_3 = Data(typical_floor_height_2)
brep_4 = Data(brep_2)

# ----
# Single Floors Building Base
bounding_box = BoundingBox(Content=stream_gate.Target1, Plane=PlaneXY(0, 0, 0), UnionBox=True)  # -> Box, Box_2
bounding_box_2 = BoundingBox(Content=stream_gate.Target1, Plane=PlaneXY(0, 0, 0), UnionBox=True)  # -> Box, Box_2
deconstruct_box = DeconstructBox(Box=bounding_box_2.Box)  # -> Plane, X, Y, Z
evaluate_box = EvaluateBox(Box=bounding_box.Box, UParameter=0.5, VParameter=0.5, WParameter="0")  # -> Plane, Point, Include
number = Number(deconstruct_box.Z)
unit_z = UnitZ(Factor=number)
move = Move(Geometry=evaluate_box.Plane, Motion=unit_z)  # -> Geometry, Transform
merge = Merge(Data1=evaluate_box.Plane, Data2=move.Geometry)
brep_plane = BrepPlane(Brep=brep_4, Plane=merge)  # -> flatten(Curves), Points

ground_floor_height_4 = Data(ground_floor_height_2)
typical_floor_height_4 = Data(typical_floor_height_2)
brep_5 = Data(brep_2)

# ----
# Multiple Floors Building Base
bounding_box_3 = BoundingBox(Content=stream_gate.Target0, Plane=PlaneXY(0, 0, 0), UnionBox=True)  # -> Box, Box_2
evaluate_box_2 = EvaluateBox(Box=bounding_box_3.Box, UParameter=0.5, VParameter=0.5, WParameter="1")  # -> Plane, Point, Include
evaluate_box_3 = EvaluateBox(Box=bounding_box_3.Box, UParameter=0.5, VParameter=0.5, WParameter="0")  # -> Plane, Point, Include
distance = Distance(PointA=evaluate_box_3.Point, PointB=evaluate_box_2.Point)
subtraction = Subtraction(A=distance, B=ground_floor_height_3)
division = Division(A=subtraction, B=typical_floor_height_3)
round = Round(Number=division)  # -> Nearest, Floor, Ceiling
series = Series(Start=ground_floor_height_4, Step=typical_floor_height_4, Count=expr("x+1", round.Floor))
merge_2 = Merge(Data1=flatten("0"), Data2=flatten(series))
unit_z_2 = UnitZ(Factor=merge_2)
integer = Integer(merge_2)
relative_differences = RelativeDifferences(Values=integer)
move_2 = Move(Geometry=evaluate_box_3.Plane, Motion=unit_z_2)  # -> Geometry, Transform
cull_index = CullIndex(List=relative_differences, Indices="0", Wrap=True)
brep_plane_2 = BrepPlane(Brep=brep_5, Plane=move_2.Geometry)  # -> flatten(Curves), Points
shift_list = ShiftList(List=brep_plane_2.Curves, Shift=-1, Wrap=False)
shift_list_2 = ShiftList(List=brep_plane_2.Curves, Shift=1, Wrap=False)
area = Area(Geometry=shift_list_2)  # -> Area, Centroid
area_2 = Area(Geometry=shift_list)  # -> Area, Centroid
xy_plane = XYPlane(Origin=area.Centroid)
list_item_2 = ListItem(List=brep_plane_2.Curves, Index=0, Wrap=True)
project = Project(Geometry=area_2.Centroid, Plane=xy_plane)  # -> Geometry, Transform
vector_2pt = Vector2Pt(PointA=area_2.Centroid, PointB=project.Geometry, Unitize=False)  # -> Vector, Length
move_3 = Move(Geometry=shift_list, Motion=vector_2pt.Vector)  # -> Geometry, Transform
merge_3 = Merge(Data1=simplify(graft(move_3.Geometry)), Data2=simplify(graft(shift_list_2)))
region_union = RegionUnion(Curves=merge_3)  # -> flatten(Result)
merge_4 = Merge(Data1=simplify(flatten(list_item_2)), Data2=simplify(flatten(region_union)))

building_type_4 = Data(building_type_2)

stream_filter = StreamFilter(Gate=building_type_4, Stream0=merge_4, Stream1=brep_plane.Curves)
stream_filter_2 = StreamFilter(Gate=building_type_4, Stream0=brep_plane_2.Curves, Stream1=brep_plane.Curves)
stream_filter_3 = StreamFilter(Gate=building_type_4, Stream0=cull_index, Stream1=number)

slab_thickness_3 = Data(slab_thickness_2)
slabs_outlines = Data(stream_filter)
slabs_outlines_2 = Data(slabs_outlines)

panel = Panel("Slabs Creation")
unit_z_3 = UnitZ(Factor=expr("-x", slab_thickness_3))
boundary_surfaces = BoundarySurfaces(Edges=slabs_outlines_2)
extrude = Extrude(Base=boundary_surfaces, Direction=unit_z_3)

floors_outlines = Data(stream_filter_2)
levels_offsets = Data(stream_filter_3)
floors_outlines_2 = Data(floors_outlines)

# ----
# Floors Outlines to Facade Outlines
area_3 = Area(Geometry=floors_outlines_2)  # -> Area, Centroid
deconstruct = Deconstruct(Point=area_3.Centroid)  # -> XComponent, YComponent, ZComponent
sort_list = SortList(Keys=deconstruct.ZComponent, ValuesValuesA=floors_outlines_2)  # -> Keys, ValuesValuesA
cull_index_2 = CullIndex(List=reverse(sort_list.ValuesValuesA), Indices="0", Wrap=True)  # -> reverse(List)

mesh_brep = MeshBrep(
    Brep=extrude,
    Settings={GridMaxCount=0, GridMinCount=16, JaggedSeams=False, MaxEdgeLength=0, MinEdgeLength=0.0001, MinTolerance=0, Refine=True, RefineAngle=0, RelativeTolerance=0.65, SimplePlanes=True, Tolerance=0})
geometry = Geometry(mesh_brep)
facade_outline = Data(cull_index_2)
facade_outline_2 = Data(facade_outline)
maximum_room_width_3 = Data(maximum_room_width_2)
minimum_room_width_3 = Data(minimum_room_width_2)
randomness_seed_3 = Data(randomness_seed_2)
facade_outline_3 = Data(facade_outline)
ribbs_spacing_3 = Data(ribbs_spacing_2)
facade_outline_4 = Data(facade_outline)
facade_outline_5 = Data(facade_outline)

panel_2 = Panel("Glass Facade Creation")

glass_thickness_3 = Data(glass_thickness_2)
glass_position_3 = Data(glass_position_2)
glass_position_4 = Data(glass_position_2)
building_type_5 = Data(building_type_2)

# ----
# Facade Module Points Generating
explode = Explode(Curve=facade_outline_2, Recursive=True)  # -> simplify(Segments), Vertices
divide_length = DivideLength(Curve=explode.Segments, Length=ribbs_spacing_3)  # -> Points, Tangents, Parameters
list_length = ListLength(List=divide_length.Points)  # -> simplify(Length)
divide_curve = DivideCurve(Curve=simplify(graft(explode.Segments)), Count=list_length, Kinks=False)  # -> simplify(Points), Tangents, Parameters
shift_paths = ShiftPaths(Data=divide_curve.Points, Offset=-1)
stream_filter_4 = StreamFilter(Gate=building_type_5, Stream0=shift_paths, Stream1=divide_curve.Points)
cull_duplicates = CullDuplicates(Points=stream_filter_4, Tolerance=0.1, CullMode=3)  # -> simplify(Points), Indices, Valence

facade_module_points = Data(cull_duplicates.Points)
inner_walls_distribution_3 = Data(inner_walls_distribution_2)
facade_outline_6 = Data(facade_outline)
facade_outline_7 = Data(facade_outline)
slab_thickness_4 = Data(slab_thickness_2)
levels_offsets_2 = Data(levels_offsets)

area_4 = Area(Geometry=facade_outline_4)  # -> Area, Centroid
area_5 = Area(Geometry=facade_outline_5)  # -> Area, Centroid
xy_plane_2 = XYPlane(Origin=area_4.Centroid)
xy_plane_3 = XYPlane(Origin=area_5.Centroid)
addition = Addition(A=glass_position_4, B=glass_thickness_3)
offset_curve = OffsetCurve(
    Curve=simplify(graft(facade_outline_4)),
    Distance=expr("-x", simplify(graft(glass_position_3))),
    Plane=simplify(graft(xy_plane_2)),
    Corners=1)
offset_curve_2 = OffsetCurve(
    Curve=simplify(graft(facade_outline_4)),
    Distance=simplify(graft(glass_position_3)),
    Plane=simplify(graft(xy_plane_2)),
    Corners=1)
offset_curve_3 = OffsetCurve(
    Curve=simplify(graft(facade_outline_5)),
    Distance=expr("-x", simplify(graft(addition))),
    Plane=simplify(graft(xy_plane_3)),
    Corners=1)
offset_curve_4 = OffsetCurve(
    Curve=simplify(graft(facade_outline_5)),
    Distance=simplify(graft(addition)),
    Plane=simplify(graft(xy_plane_3)),
    Corners=1)
length = Length(Curve=offset_curve)
length_2 = Length(Curve=offset_curve_2)
length_3 = Length(Curve=offset_curve_3)
length_4 = Length(Curve=offset_curve_4)
merge_5 = Merge(Data1=length, Data2=length_2)
merge_6 = Merge(Data1=offset_curve, Data2=offset_curve_2)
merge_7 = Merge(Data1=length_3, Data2=length_4)
merge_8 = Merge(Data1=offset_curve_3, Data2=offset_curve_4)
sort_list_2 = SortList(Keys=merge_5, ValuesValuesA=merge_6)  # -> Keys, ValuesValuesA
sort_list_3 = SortList(Keys=merge_7, ValuesValuesA=merge_8)  # -> Keys, ValuesValuesA
list_item_3 = ListItem(List=sort_list_2.ValuesValuesA, Index=0, Wrap=True)  # -> simplify(Item)
list_item_4 = ListItem(List=sort_list_3.ValuesValuesA, Index=0, Wrap=True)  # -> simplify(Item)
flatten_tree = FlattenTree(Tree=list_item_3, Path="{0}")
flatten_tree_2 = FlattenTree(Tree=list_item_4, Path="{0}")
merge_9 = Merge(Data1=simplify(graft(flatten_tree)), Data2=simplify(graft(flatten_tree_2)))
subtraction_2 = Subtraction(A=levels_offsets_2, B=slab_thickness_4)
unit_z_4 = UnitZ(Factor=subtraction_2)
boundary_surfaces_2 = BoundarySurfaces(Edges=merge_9)
extrude_2 = Extrude(Base=boundary_surfaces_2, Direction=simplify(graft(unit_z_4)))

facade_module_points_2 = Data(facade_module_points)
facade_outline_8 = Data(facade_outline)
facade_module_points_3 = Data(facade_module_points)
facade_outline_9 = Data(facade_outline)
facade_outline_10 = Data(facade_outline)
mesh_brep_2 = MeshBrep(
    Brep=extrude_2,
    Settings={GridMaxCount=0, GridMinCount=16, JaggedSeams=False, MaxEdgeLength=0, MinEdgeLength=0.0001, MinTolerance=0, Refine=True, RefineAngle=0, RelativeTolerance=0.65, SimplePlanes=True, Tolerance=0})
glass = Geometry(mesh_brep_2)
facade_module_points_4 = Data(facade_module_points)
ribs_2nd_dimension_3 = Data(ribs_2nd_dimension_2)
ribs_1st_dimension_3 = Data(ribs_1st_dimension_2)
facade_outline_11 = Data(facade_outline)
ribs_position_3 = Data(ribs_position_2)
facade_module_points_5 = Data(facade_module_points)
facade_outline_12 = Data(facade_outline)

explode_2 = Explode(Curve=facade_outline_7, Recursive=True)  # -> Segments, Vertices
area_6 = Area(Geometry=facade_outline_7)  # -> Area, Centroid
length_5 = Length(Curve=explode_2.Segments)  # -> simplify(Length)
larger_than = LargerThan(FirstNumber=length_5, SecondNumber=Slider(3000, range=0..10000))  # -> LargerThan, OrEqualTo
cull_pattern = CullPattern(List=length_5, CullPattern=larger_than.LargerThan)
sort_list_4 = SortList(Keys=cull_pattern)  # -> Keys, ValuesValuesA
list_item_5 = ListItem(List=sort_list_4.Keys, Index=0, Wrap=True)
xy_plane_4 = XYPlane(Origin=area_6.Centroid)
subtraction_3 = Subtraction(A=list_item_5, B=Slider(1500, range=0..10000))
division_2 = Division(A=subtraction_3, B=Slider(2, range=0..10))
offset_curve_5 = OffsetCurve(
    Curve=simplify(graft(facade_outline_12)),
    Distance=expr("-x", simplify(graft(division_2))),
    Plane=simplify(graft(xy_plane_4)),
    Corners=1)
offset_curve_6 = OffsetCurve(
    Curve=simplify(graft(facade_outline_12)),
    Distance=simplify(graft(division_2)),
    Plane=simplify(graft(xy_plane_4)),
    Corners=1)
length_6 = Length(Curve=offset_curve_5)
length_7 = Length(Curve=offset_curve_6)
merge_10 = Merge(Data1=length_6, Data2=length_7)
merge_11 = Merge(Data1=offset_curve_5, Data2=offset_curve_6)
sort_list_5 = SortList(Keys=merge_10, ValuesValuesA=merge_11)  # -> Keys, ValuesValuesA
list_item_6 = ListItem(List=sort_list_5.ValuesValuesA, Index=0, Wrap=True)  # -> simplify(Item)
flatten_tree_3 = FlattenTree(Tree=list_item_6, Path="{0}")

facade_outline_13 = Data(facade_outline)
building_type_6 = Data(building_type_2)

division_3 = Division(A=maximum_room_width_3, B="100")
division_4 = Division(A=minimum_room_width_3, B="100")
list_length_2 = ListLength(List=facade_outline_3)
construct_domain = ConstructDomain(DomainStart=division_4, DomainEnd=division_3)
series_2 = Series(Start=randomness_seed_3, Step=1, Count=list_length_2)
random = Random(Range=construct_domain, Number="100", Seed=series_2, Integers=True)  # -> simplify(Random)
multiplication = Multiplication(A=random, B="100")
tree_statistics = TreeStatistics(Tree=multiplication)  # -> Paths, Length, Count
list_item_7 = ListItem(List=tree_statistics.Paths, Index=0, Wrap=True)
tree_branch = TreeBranch(Tree=multiplication, Path=list_item_7, MaintainPaths=True)  # -> simplify(graft(Branch))
repeat_data = RepeatData(Data=tree_branch, Length=tree_statistics.Count)  # -> simplify(Data)
flip_matrix = FlipMatrix(Data=repeat_data)
stream_filter_5 = StreamFilter(Gate=inner_walls_distribution_3, Stream0=multiplication, Stream1=flip_matrix)
dash_pattern = DashPattern(Curve=simplify(graft(facade_outline_6)), Pattern=stream_filter_5)  # -> simplify(Dashes), simplify(Gaps)
merge_12 = Merge(Data1=dash_pattern.Dashes, Data2=dash_pattern.Gaps)
join_curves = JoinCurves(Curves=merge_12, Preserve=False)  # -> simplify(Curves)
explode_3 = Explode(Curve=facade_outline_8, Recursive=True)  # -> Segments, simplify(Vertices)
explode_4 = Explode(Curve=join_curves, Recursive=True)  # -> Segments, simplify(Vertices)
cull_index_3 = CullIndex(List=explode_4.Vertices, Indices="0", Wrap=False)
pull_point = PullPoint(Point=facade_module_points_2, Geometry=explode_3.Vertices, ClosestOnly=True)  # -> ClosestPoint, Distance
cull_index_4 = CullIndex(List=reverse(cull_index_3), Indices="0", Wrap=False)  # -> reverse(List)
larger_than_2 = LargerThan(FirstNumber=pull_point.Distance, SecondNumber=expr("x*100", division_4))  # -> LargerThan, OrEqualTo
end_points = EndPoints(Curve=facade_outline_10)  # -> Start, End
data = Data(simplify(cull_index_4))
distance_2 = Distance(PointA=end_points.Start, PointB=data)  # -> simplify(graft(Distance))
distance_3 = Distance(PointA=end_points.End, PointB=data)  # -> simplify(graft(Distance))
cull_pattern_2 = CullPattern(List=simplify(facade_module_points_4), CullPattern=larger_than_2.LargerThan)  # -> simplify(List)
merge_13 = Merge(Data1=distance_2, Data2=distance_3)
sort_list_6 = SortList(Keys=merge_13)  # -> Keys, ValuesValuesA
list_item_8 = ListItem(List=sort_list_6.Keys, Index=0, Wrap=True)
shift_paths_2 = ShiftPaths(Data=list_item_8, Offset=-1)
stream_filter_6 = StreamFilter(Gate=building_type_6, Stream0=shift_paths_2, Stream1=list_item_8)
larger_than_3 = LargerThan(FirstNumber=stream_filter_6, SecondNumber=expr("x*100", division_4))  # -> LargerThan, OrEqualTo
cull_pattern_3 = CullPattern(List=data, CullPattern=larger_than_3.LargerThan)
closest_point = ClosestPoint(Point=cull_pattern_3, Cloud=cull_pattern_2)  # -> ClosestPoint, CPIndex, Distance

levels_offsets_3 = Data(levels_offsets)

panel_3 = Panel("Ribbs Generating")
explode_5 = Explode(Curve=facade_outline_9, Recursive=True)  # -> Segments, simplify(Vertices)
removal_distance_from_corners = Slider(0, range=0..10000)
pull_point_2 = PullPoint(Point=facade_module_points_3, Geometry=explode_5.Vertices, ClosestOnly=True)  # -> ClosestPoint, Distance
larger_than_4 = LargerThan(FirstNumber=pull_point_2.Distance, SecondNumber=removal_distance_from_corners)  # -> LargerThan, OrEqualTo
cull_pattern_4 = CullPattern(List=simplify(facade_module_points_5), CullPattern=larger_than_4.LargerThan)  # -> simplify(List)
curve_closest_point = CurveClosestPoint(Point=cull_pattern_4, Curve=simplify(graft(facade_outline_11)))  # -> Point, Parameter, Distance
negative = Negative(Value=ribs_1st_dimension_3)
addition_2 = Addition(A=ribs_position_3, B=ribs_2nd_dimension_3)
horizontal_frame = HorizontalFrame(Curve=simplify(graft(facade_outline_13)), Parameter=simplify(curve_closest_point.Parameter))
construct_domain_2 = ConstructDomain(DomainStart=expr("x/2", negative), DomainEnd=expr("x/2", ribs_1st_dimension_3))
construct_domain_3 = ConstructDomain(DomainStart=ribs_position_3, DomainEnd=addition_2)
rectangle = Rectangle(Plane=horizontal_frame, XSize=construct_domain_2, YSize=construct_domain_3, Radius=0)  # -> Rectangle, Length
tree_statistics_2 = TreeStatistics(Tree=rectangle.Rectangle)  # -> Paths, Length, Count
list_item_9 = ListItem(List=tree_statistics_2.Paths, Index=0, Wrap=True)
split_tree = SplitTree(Data=rectangle.Rectangle, Masks=flatten(list_item_9))  # -> Positive, Negative
subtraction_4 = Subtraction(A=levels_offsets_3, B=50)
list_item_10 = ListItem(List=subtraction_4, Index=0, Wrap=True)  # -> Item, Item1
rectangle_2 = Rectangle(Plane=PlaneXY(0, 0, 0), XSize=construct_domain_2, YSize=construct_domain_3, Radius=0)  # -> Rectangle, Length
unit_z_5 = UnitZ(Factor=list_item_10.Item)
unit_z_6 = UnitZ(Factor=list_item_10.Item1)
extrude_3 = Extrude(Base=rectangle_2.Rectangle, Direction=unit_z_5)
extrude_4 = Extrude(Base=rectangle_2.Rectangle, Direction=unit_z_6)
cap_holes = CapHoles(Brep=extrude_3)
cap_holes_2 = CapHoles(Brep=extrude_4)
simple_mesh = SimpleMesh(Brep=cap_holes_2)
simple_mesh_2 = SimpleMesh(Brep=cap_holes)
orient = Orient(Geometry=simple_mesh, Source=rectangle_2.Rectangle, Target=split_tree.Negative)  # -> Geometry, Transform
orient_2 = Orient(Geometry=simple_mesh_2, Source=rectangle_2.Rectangle, Target=split_tree.Positive)  # -> Geometry, Transform

facade_outline_14 = Data(facade_outline)
geometry_2 = Geometry(flatten([orient_2.Geometry, orient.Geometry]))
brep_6 = Data(brep_2)
brep_7 = Data(brep_2)
levels_offsets_4 = Data(levels_offsets)
slab_thickness_5 = Data(slab_thickness_2)
levels_offsets_5 = Data(levels_offsets)
slab_thickness_6 = Data(slab_thickness_2)
glass_2 = Geometry(flatten(glass))
area_7 = Area(Geometry=boundary_surfaces)  # -> Area, Centroid
ribs = Geometry(flatten(geometry_2))
slabs = Geometry(flatten(geometry))
deconstruct_2 = Deconstruct(Point=area_7.Centroid)  # -> XComponent, YComponent, ZComponent
materials = Panel("""Concrete
Wood
Paint
Glass""")
sort_list_7 = SortList(Keys=deconstruct_2.ZComponent, ValuesValuesA=area_7.Centroid, ValuesA=area_7.Area)  # -> Keys, ValuesValuesA, ValuesA
list_length_3 = ListLength(List=slabs)
list_length_4 = ListLength(List=ribs)
list_length_5 = ListLength(List=glass_2)
list_length_6 = ListLength(List=sort_list_7.ValuesValuesA)
division_5 = Division(A=sort_list_7.ValuesA, B=1000000)
round_2 = Round(Number=division_5)  # -> Nearest, Floor, Ceiling
series_3 = Series(Start=1, Step=1, Count=list_length_6)
panel_4 = Panel("sqm")
panel_5 = Panel(": ")
concatenate = Concatenate(FragmentA="Floor ", FragmentB=series_3)
custom_preview = CustomPreview(Geometry=slabs, Material=ColourSwatch(SwatchColor=RGB(222, 222, 222)))
custom_preview_2 = CustomPreview(Geometry=ribs, Material=ColourSwatch(SwatchColor=RGB(222, 222, 222)))
custom_preview_3 = CustomPreview(Geometry=glass_2, Material=ColourSwatch(SwatchColor=RGBA(140, 222, 196, 40)))
panel_6 = Panel("""Option 01
Option 02
Option 03
Option 04
Option 05
Option 06""")
levels_offsets_6 = Data(levels_offsets)
fpy = FPy(x=levels_offsets_6)  # -> out, a; inputs x: list
# ---------- fpy: Python ----------
set=list(set(x))
set=sorted(set)
print set
foo={}
for i,v in enumerate(set):
    for j in x:
        if j == v:
            sum=foo.get(i,0)
            foo[i]=sum + j

total=0
values=[]
for key in foo.keys():
    value=foo[key]
    values.append(value)
    total+=value

quotas=[round(i/total,2) for i in values]
print total
print values
print quotas
a=values
# ---------- end fpy ----------
mass_addition = MassAddition(Input=round_2.Nearest)  # -> Result, PartialResults
list_item_11 = ListItem(List=panel_6, Index=options, Wrap=True)
dsfixedinput = Panel("""Office
Commercial""")
merge_14 = Merge(Data1=ColourSwatch(SwatchColor=RGB(112, 146, 255)), Data2=ColourSwatch(SwatchColor=RGB(80, 171, 41)))
panel_7 = Panel("""Total Area : 

-------------""")
concatenate_2 = Concatenate(
    C=flatten("# Areas"),
    D="## ",
    Fragment_A=list_item_11,
    Fragment_B="**Total Area :",
    A=mass_addition.Result,
    B="sqm**",
    F="-----")
doughnut = FPy(header="Program Distribution", labels=dsfixedinput, data=fpy.a, colours=merge_14)  # -> out, a; inputs labels: list, data: list, colours: list
# ---------- doughnut: Python ----------
import ghpythonlib.components as ghc


colour=[]
for c in colours:
    s="rgb({},{},{},{})".format(c[0],c[1],c[2],c[3]/255)
    colour.append(s)



out={
    "type": "doughnut",
    "data": {
        "labels": labels,
        "datasets": [{
            "label": header,
            "data": data,
            "backgroundColor": colour,
            "hoverOffset": 4}]
        }
}

a=str(out)
# ---------- end doughnut ----------
merge_15 = Merge(Data1=flatten(concatenate_2), Data2=flatten(concatenate))
dash_doughnut_program = Data(doughnut.a)
markdown = FPy(text=merge_15)  # -> out, a; inputs text: list
# ---------- markdown: Python ----------
string="\n".join(text)

print string


out={
    "type": "markdown",
    "data": {
        "datasets": [{
            "string": string}]
        }
}

a=str(out)
# ---------- end markdown ----------
graph = FPy(header="Area per Floor (sqm)", labels=concatenate, data=round_2.Nearest, colour=ColourSwatch(SwatchColor=RGB(0, 0, 0)))  # -> out, a; inputs labels: list, data: list
# ---------- graph: Python ----------
import ghpythonlib.components as ghc

c=colour
colour="rgb({},{},{},{})".format(c[0],c[1],c[2],c[3]/255)



out={
    "type": "line",
    "data": {
        "labels": labels,
        "datasets": [{
            "label": header,
            "data": data,
            "fill": "false",
            "borderColor": colour,
            "tension": 0.1
            }]
        }
}

a=str(out)
# ---------- end graph ----------
dash_graph_area = Data(graph.a)
image = FPy(file="dash_001.jpg")  # -> out, a; inputs file: list
# ---------- image: Python ----------
out={
    "type": "image",
    "data": {
        "datasets": [{
            "link": file}]
        }
}

a=str(out)
# ---------- end image ----------
dsfixedinput_2 = Panel("""Option 01
Option 02
Option 03
Option 04
Option 05
Option 06""")
dsfixedinput_3 = Panel("""Option 01
Option 02
Option 03
Option 04
Option 05
Option 06""")
dsfixedinput_4 = Panel("""Dynamic
Typical""")
dsfixedinput_5 = Panel("""0
1
2
3
4
5""")
dsfixedinput_6 = Panel("""0
1
2
3
4
5""")
dsfixedinput_7 = Panel("""0
1""")
slider = FPy(name="RH_IN:Randomness_Seed", min="0", max="100", step="1", default="0")  # -> out, a
# ---------- slider: Python ----------
if label:
    display_name=label
else:
    display_name=name.split("RH_IN:")[1]
    display_name=display_name.split("_")
    display_name=[i.capitalize() for i in display_name]
    display_name=" ".join(display_name)

out={
    "name": name,
    "type": "range",
    "maxValue": max,
    "minValue":min,
    "stepSize":step,
    "displayName":display_name,
    "defaultValue":default
    }

a=str(out)
# ---------- end slider ----------
slider_2 = FPy(name="RH_IN:Minimum_Room_Width", min="500", max="20000", step="500", default="3000")  # -> out, a; same code as slider
slider_3 = FPy(name="RH_IN:Slab_Thickness", min="200", max="1000", step="50", default="300")  # -> out, a; same code as slider
dash_graph_area_2 = Data(dash_graph_area)
slider_4 = FPy(name="RH_IN:Typical_Floor_Height", min="2500", max="5000", step="100", default="3000")  # -> out, a; same code as slider
slider_5 = FPy(name="RH_IN:Ground_Floor_Height", min="2500", max="20000", step="500", default="5000")  # -> out, a; same code as slider
slider_6 = FPy(name="RH_IN:Ribs_Position", min="-10000", max="10000", step="100", default="0")  # -> out, a; same code as slider
slider_7 = FPy(name="RH_IN:Maximum_Room_Width", min="3000", max="20000", step="500", default="6000")  # -> out, a; same code as slider
dropdown = FPy(name="RH_IN:Inner_Walls_Distribution", keys=dsfixedinput_4, values=dsfixedinput_7)  # -> out, a; inputs keys: list, values: list
# ---------- dropdown: Python ----------
if label:
    display_name=label
else:
    display_name=name.split("RH_IN:")[1]
    display_name=display_name.split("_")
    display_name=[i.capitalize() for i in display_name]
    display_name=" ".join(display_name)


option_tuples=zip(keys,values)

options=[]
for tup in option_tuples:
    d={
    "name":tup[0],
    "value":tup[1]
    }
    options.append(d)

out={
    "name": name,
    "type": "singleSelect",
    "options": options,
    "displayName":display_name
    }

a=str(out)
# ---------- end dropdown ----------
slider_8 = FPy(name="RH_IN:Ribs_1st_Dim", min="0", max="200", step="10", default="20")  # -> out, a; same code as slider
slider_9 = FPy(name="RH_IN:Ribs_2nd_Dim", min="10", max="20000", step="10", default="300")  # -> out, a; same code as slider
markdown_2 = FPy(text="# Floor Dimensions")  # -> a; inputs text: list; same code as markdown
slider_10 = FPy(name="RH_IN:Ribs_Spacing", min="500", max="20000", step="100", default="1000")  # -> out, a; same code as slider
dropdown_2 = FPy(name="RH_IN:Building_Type", keys=dsfixedinput_2, values=dsfixedinput_5)  # -> a; inputs keys: list, values: list; same code as dropdown
dropdown_3 = FPy(name="RH_IN:Options", keys=dsfixedinput_3, values=dsfixedinput_6)  # -> a; inputs keys: list, values: list; same code as dropdown
markdown_3 = FPy(text="# Rib Dimensions")  # -> a; inputs text: list; same code as markdown
markdown_4 = FPy(text="# Room Dimensions")  # -> a; inputs text: list; same code as markdown
markdown_5 = FPy(text="# Options")  # -> a; inputs text: list; same code as markdown
slider_11 = FPy(name="RH_IN:Glass_Thickness", min="0", max="500", step="50", default="50")  # -> out, a; same code as slider
slider_12 = FPy(name="RH_IN:Glass_Position", min="0", max="10000", step="50", default="500")  # -> out, a; same code as slider
markdown_6 = FPy(text="# Glass Dimensions")  # -> a; inputs text: list; same code as markdown
entwine = Entwine(
    Branch00=markdown_3,
    Branch01=slider_6.a,
    Branch02=slider_8.a,
    Branch03=slider_9.a,
    Branch04=slider_10.a,
    FlattenInputs=True)  # -> flatten(Result)
entwine_2 = Entwine(
    Branch00=markdown_2,
    Branch01=dash_graph_area_2,
    Branch02=slider_5.a,
    Branch03=slider_4.a,
    Branch04=slider_3.a,
    FlattenInputs=True)  # -> flatten(Result)
entwine_3 = Entwine(Branch00=markdown_6, Branch01=slider_12.a, Branch02=slider_11.a, FlattenInputs=True)  # -> flatten(Result)
entwine_4 = Entwine(Branch00=markdown_5, Branch01=image.a, Branch02=dropdown_3, Branch03=dropdown_2, Branch04=slider.a, FlattenInputs=True)  # -> flatten(Result)
entwine_5 = Entwine(Branch00=markdown_4, Branch01=slider_2.a, Branch02=slider_7.a, Branch03=dropdown.a, FlattenInputs=True)  # -> flatten(Result)
dash_doughnut_program_2 = Data(dash_doughnut_program)

# ----
# Inner Walls Distribution And Creation
inner_walls_points = Data(closest_point.ClosestPoint)
inner_walls_points_2 = Data(inner_walls_points)

curve_closest_point_2 = CurveClosestPoint(Point=inner_walls_points_2, Curve=simplify(graft(facade_outline_14)))  # -> Point, Parameter, Distance
perp_frame = PerpFrame(Curve=simplify(graft(facade_outline_14)), Parameter=curve_closest_point_2.Parameter)
curve_plane = CurvePlane(Curve=simplify(graft(flatten_tree_3)), Plane=simplify(perp_frame))  # -> Points, ParamsC, ParamsP
sort_list_8 = SortList(Keys=curve_plane.ParamsP, ValuesValuesA=curve_plane.Points)  # -> Keys, ValuesValuesA
list_item_12 = ListItem(List=sort_list_8.ValuesValuesA, Index=0, Wrap=True)  # -> simplify(Item)
shift_paths_3 = ShiftPaths(Data=list_item_12, Offset=-1)
line = Line(StartPoint=curve_closest_point_2.Point, EndPoint=shift_paths_3)
multiple_curves = MultipleCurves(Curves=line)  # -> Points, IndexA, IndexB, ParamA, ParamB
list_item_13 = ListItem(List=line, Index=multiple_curves.IndexA, Wrap=True)
panel_8 = Panel(multiple_curves.IndexA)
length_8 = Length(Curve=list_item_13)
sort_list_9 = SortList(Keys=length_8, ValuesValuesA=multiple_curves.IndexA)  # -> Keys, ValuesValuesA
cull_index_5 = CullIndex(List=line, Indices=sort_list_9.ValuesValuesA, Wrap=True)  # -> simplify(List)
trim_with_brep = TrimWithBrep(Curve=flatten_tree_3, Brep=brep_6)  # -> Inside, Outside
trim_with_brep_2 = TrimWithBrep(Curve=cull_index_5, Brep=brep_7)  # -> Inside, Outside
shift_paths_4 = ShiftPaths(Data=trim_with_brep.Inside, Offset=-1)
shift_paths_5 = ShiftPaths(Data=trim_with_brep_2.Inside, Offset=-1)

inner_walls_curves_02 = Data(shift_paths_5)
inner_walls_curves_01 = Data(shift_paths_4)

number_slider = Slider(200, range=0..1000)
inner_walls_curves_02_2 = Data(inner_walls_curves_02)
inner_walls_curves_01_2 = Data(inner_walls_curves_01)
offset_curve_7 = OffsetCurve(Curve=inner_walls_curves_02_2, Distance=expr("-x/2", number_slider), Plane=PlaneXY(0, 0, 0), Corners=1)  # -> simplify(Curve)
offset_curve_8 = OffsetCurve(Curve=inner_walls_curves_02_2, Distance=expr("x/2", number_slider), Plane=PlaneXY(0, 0, 0), Corners=1)  # -> simplify(Curve)
offset_curve_9 = OffsetCurve(Curve=inner_walls_curves_01_2, Distance=expr("-x/2", number_slider), Plane=PlaneXY(0, 0, 0), Corners=1)  # -> simplify(Curve)
offset_curve_10 = OffsetCurve(Curve=inner_walls_curves_01_2, Distance=expr("x/2", number_slider), Plane=PlaneXY(0, 0, 0), Corners=1)  # -> simplify(Curve)
merge_16 = Merge(Data1=offset_curve_10, Data2=offset_curve_9)
end_points_2 = EndPoints(Curve=offset_curve_8)  # -> Start, End
end_points_3 = EndPoints(Curve=offset_curve_7)  # -> Start, End
line_2 = Line(StartPoint=end_points_2.Start, EndPoint=end_points_3.Start)
line_3 = Line(StartPoint=end_points_2.End, EndPoint=end_points_3.End)
subtraction_5 = Subtraction(A=levels_offsets_4, B=slab_thickness_5)
merge_17 = Merge(Data1=offset_curve_8, Data2=line_2, Data3=offset_curve_7, Data4=line_3)
unit_z_7 = UnitZ(Factor=subtraction_5)
join_curves_2 = JoinCurves(Curves=simplify(merge_17), Preserve=False)  # -> simplify(Curves)
curve = Curve(join_curves_2)
shift_paths_6 = ShiftPaths(Data=curve, Offset=-1)
move_4 = Move(Geometry=simplify(shift_paths_6), Motion=simplify(graft(unit_z_7)))  # -> Geometry, Transform
merge_18 = Merge(Data1=simplify(graft(move_4.Geometry)), Data2=simplify(graft(shift_paths_6)))
boundary_surfaces_3 = BoundarySurfaces(Edges=merge_16)
explode_6 = Explode(Curve=merge_18, Recursive=True)  # -> Segments, Vertices
cull_index_6 = CullIndex(List=explode_6.Vertices, Indices=0, Wrap=True)
shift_paths_7 = ShiftPaths(Data=simplify(cull_index_6), Offset=-1)
tree_statistics_3 = TreeStatistics(Tree=shift_paths_7)  # -> Paths, Length, Count
list_item_14 = ListItem(List=tree_statistics_3.Paths, Index=0, Wrap=True)
tree_branch_2 = TreeBranch(Tree=shift_paths_7, Path=list_item_14, MaintainPaths=True)
gene_pool = GenePool(Decimals=0, Maximum=7, Minimum=0, Value=[1, 2, 6, 5])
gene_pool_2 = GenePool(Decimals=0, Maximum=7, Minimum=0, Value=[0, 1, 2, 3])
gene_pool_3 = GenePool(Decimals=0, Maximum=7, Minimum=0, Value=[0, 3, 7, 4])
gene_pool_4 = GenePool(Decimals=0, Maximum=7, Minimum=0, Value=[3, 2, 6, 7])
gene_pool_5 = GenePool(Decimals=0, Maximum=7, Minimum=0, Value=[4, 5, 6, 7])
gene_pool_6 = GenePool(Decimals=0, Maximum=7, Minimum=0, Value=[0, 1, 5, 3.5])
subtraction_6 = Subtraction(A=levels_offsets_5, B=slab_thickness_6)
list_item_15 = ListItem(List=shift_paths_7, Index=gene_pool, Wrap=True)
list_item_16 = ListItem(List=shift_paths_7, Index=gene_pool_2, Wrap=True)
list_item_17 = ListItem(List=shift_paths_7, Index=gene_pool_3, Wrap=True)
list_item_18 = ListItem(List=shift_paths_7, Index=gene_pool_4, Wrap=True)
list_item_19 = ListItem(List=shift_paths_7, Index=gene_pool_5, Wrap=True)
list_item_20 = ListItem(List=shift_paths_7, Index=gene_pool_6, Wrap=True)
unit_z_8 = UnitZ(Factor=simplify(graft(subtraction_6)))
extrude_5 = Extrude(Base=boundary_surfaces_3, Direction=simplify(unit_z_8))

merge_19 = Merge(Data1=list_item_20, Data2=list_item_18, Data3=list_item_19, Data4=list_item_16, Data5=list_item_17, Data6=list_item_15)

partition_list = PartitionList(List=merge_19, Size="4")  # -> simplify(Chunks)
construct_mesh = ConstructMesh(Vertices=partition_list, Faces={A=0, B=1, C=2, D=3})  # -> flatten(Mesh)

mesh_brep_3 = MeshBrep(
    Brep=extrude_5,
    Settings={GridMaxCount=0, GridMinCount=16, JaggedSeams=False, MaxEdgeLength=0, MinEdgeLength=0.0001, MinTolerance=0, Refine=True, RefineAngle=0, RelativeTolerance=0.65, SimplePlanes=True, Tolerance=0})
merge_20 = Merge(Data1=flatten(mesh_brep_3), Data2=flatten(construct_mesh))
geometry_3 = Geometry(merge_20)
innerwalls = Geometry(flatten(geometry_3))
list_length_7 = ListLength(List=innerwalls)
merge_21 = Merge(Data1=list_length_3, Data2=list_length_4, Data3=list_length_7, Data4=list_length_5)
duplicate_data = DuplicateData(Data=simplify(graft(materials)), Number=simplify(graft(merge_21)), Order=True)  # -> simplify(flatten(Data))
merge_22 = Merge(Data1=slabs, Data2=ribs, Data3=innerwalls, Data4=glass_2)
bbox = BoundingBox(Content=merge_22, Plane=PlaneXY(0, 0, 0), UnionBox=True)  # -> Box, Box_2
debox = DeconstructBox(Box=bbox.Box)  # -> Plane, X, Y, Z
dedomain = DeconstructDomain(Domain=debox.Z)  # -> Start, End
subtraction_7 = Subtraction(A=dedomain.End, B=dedomain.Start)
bounding_box_4 = BoundingBox(Content=merge_22, Plane=PlaneXY(0, 0, 0), UnionBox=True)  # -> Box, Box_2
custom_preview_4 = CustomPreview(Geometry=innerwalls, Material=ColourSwatch(SwatchColor=RGB(222, 222, 222)))
division_6 = Division(A=subtraction_7, B="1000")
deconstruct_brep = DeconstructBrep(Brep=bounding_box_4.Box)  # -> Faces, Edges, Vertices
int = Integer(division_6)
addition_3 = Addition(A=int, B="0")
deconstruct_3 = Deconstruct(Point=deconstruct_brep.Vertices)  # -> XComponent, YComponent, ZComponent
concat = Concatenate(FragmentA="**Total Height: ", FragmentB=addition_3, FragmentC="m**")
markdown_7 = FPy(text=concat)  # -> out, a; inputs text: list; same code as markdown
addition_4 = Addition(A=deconstruct_3.XComponent, B=deconstruct_3.YComponent, C=deconstruct_3.ZComponent)
sort_list_10 = SortList(Keys=addition_4, ValuesValuesA=deconstruct_brep.Vertices)  # -> Keys, ValuesValuesA
list_item_21 = ListItem(List=sort_list_10.ValuesValuesA, Index=0, Wrap=True)
merge_23 = Merge(Data1=flatten(sort_list_7.ValuesValuesA), Data2=flatten(list_item_21))

# ---- group: RH_OUT:MESH
mesh = Mesh(merge_22)

# ---- group: RH_OUT:Material
text = Text(duplicate_data)

# ---- group: RH_OUT:TextPt
point = Point(merge_23)

# ----
entwine_6 = Entwine(
    Branch00=dash_doughnut_program_2,
    Branch01=entwine_4,
    Branch02=entwine_2,
    Branch03=entwine_5,
    Branch04=entwine,
    Branch05=markdown_7.a,
    Branch06=markdown.a,
    FlattenInputs=True)  # -> flatten(Result)

# ---- group: RH_OUT:Dashboard
text_2 = Text(entwine_6)
