# Grasshopper definition humt.gh (Grasshopper 1.0.7)

# ---- group: RH_IN:panelsX
panelsx = Slider(1200, range=0..10000)

# ---- group: RH_IN:panelsY
panelsy = Slider(2000, range=0..10000)

# ----
# Control
# Hex Grid H Value - Must be greater than largest Toolhead H + Plate Thickness
# Patterning
# Paneling
panel = Panel("Pattern Toolhead Selection")
figure_offset_min_1 = Panel("1")
plate_thickness = Panel("3")
hex_grid_h_value = Panel("20")
background_h_value = Panel("14")
figure_h_value = Panel("7")
panel_zdistance = Panel("""0
2910
1940
2110
1940
2110
1855
1855""")
panel_zdistance_2 = Data(panel_zdistance)
figure_h_value_2 = Data(figure_h_value)
figure_offset = Data(figure_offset_min_1)
plate_thickness_2 = Data(plate_thickness)
hex_grid_h_value_2 = Data(hex_grid_h_value)
background_h_value_2 = Data(background_h_value)

# ----
# Z-Direction Spacing Setup
bottom_panel_zdistance = Panel("""0
2910""")
ma = MassAddition(Input=panel_zdistance)  # -> Result, PartialResults
sort = SortList(Keys=bottom_panel_zdistance)  # -> reverse(Keys), ValuesA
item = ListItem(List=sort.Keys, Index=0, Wrap=True)
subtraction = Subtraction(A=ma.Result, B=item)
mod = Modulus(A=subtraction, B=panelsy)
division = Division(A=subtraction, B=panelsy)
round = Round(Number=division)  # -> Nearest, Floor, Ceiling
repeat = RepeatData(Data=panelsy, Length=round.Floor)
merge = Merge(Data1=flatten(bottom_panel_zdistance), Data2=flatten(repeat), Data3=flatten(mod))
panel_zdistance_3 = Data(merge)

# ----
# Input
# Paneling
inp_baslinjevertikal = Geometry(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)
# Use for Input Geometry from Rhino, preferably via Geometry Pipeline
# User Interface
edge_ln = Data([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])

# ----
# Visibility
# Input
# Control
# Monitor
# Bake
# WIP
# Annotation
# Use for all parameter control
# Use for monitoring data
# Use for visibility and color preview - assemble copies of all geometry here
# Use for Work-In-Progress and Obsolete defintions - always annotate!
# Use for General Annotation
panel_2 = Panel("Use for Baking")

# ----
# Panelling
# Edge Ln Polar Sort
edge_ln_2 = Data(edge_ln)
inp_baslinjevertikal_2 = Geometry(inp_baslinjevertikal)
explode = Explode(Curve=edge_ln_2, Recursive=True)  # -> Segments, Vertices
end = EndPoints(Curve=inp_baslinjevertikal_2)  # -> Start, End
item_2 = ListItem(List=explode.Segments, Index=0, Wrap=True)  # -> flatten(Item)
xy = XYPlane(Origin=end.Start)
end_2 = EndPoints(Curve=item_2)  # -> Start, End
polar = ToPolar(Point=end_2.Start, System=xy)  # -> Phi, Theta, Radius
sort_2 = SortList(Keys=polar.Phi, ValuesA=item_2)  # -> Keys, ValuesA
edge_ln_3 = Data(sort_2.ValuesA)

# ----
# Panel Z Pln
panel_zdistance_4 = Data(merge)
ma_2 = MassAddition(Input=panel_zdistance_4)  # -> Result, PartialResults
pt = ConstructPoint(XCoordinate=0, YCoordinate=0, ZCoordinate=ma_2.PartialResults)
xy_2 = XYPlane(Origin=pt)
panel_z_pln = Data(xy_2)

# ----
# Panels Average Width Setup
edge_ln_4 = Data(edge_ln_3)
end_3 = EndPoints(Curve=edge_ln_4)  # -> Start, End
intcrv = Interpolate(Vertices=end_3.End, Degree=3, Periodic=True, KnotStyle=1)  # -> Curve, Length, Domain
intcrv_2 = Interpolate(Vertices=end_3.Start, Degree=3, Periodic=True, KnotStyle=1)  # -> Curve, Length, Domain
avr = Average(Input=[intcrv_2.Length, intcrv.Length])
division_2 = Division(A=avr, B=panelsx)
round_2 = Round(Number=division_2)  # -> Nearest, Floor, Ceiling
divide = DivideCurve(Curve=intcrv.Curve, Count=round_2.Nearest, Kinks=False)  # -> Points, Tangents, Parameters
pframe = PerpFrame(Curve=intcrv.Curve, Parameter=divide.Parameters)
pcx = CurvePlane(Curve=intcrv_2.Curve, Plane=graft(pframe))  # -> simplify(Points), ParamsC, ParamsP
sort_3 = SortList(Keys=pcx.ParamsP, ValuesA=pcx.Points)  # -> Keys, ValuesA
item_3 = ListItem(List=sort_3.ValuesA, Index=0, Wrap=True)
ln = Line(StartPoint=simplify(graft(item_3)), EndPoint=simplify(graft(divide.Points)))  # -> flatten(Line)
edge_ln_re_populated = Data(ln)

number_slider = Slider(10, range=0..10)  # disabled
number_slider_2 = Slider(50, range=0..50)  # disabled
number_slider_3 = Slider(200, range=0..200)  # disabled
number_slider_4 = Slider(43, range=0..100)  # disabled
edge_ln_5 = Data(edge_ln_re_populated)  # disabled
loft = Loft(Curves=edge_ln_5, Options={Adjust=False, Closed=True, LoftEnds=0, LoftSimp=0, LoftType=0, Rebuild=10, Refit=0.01})  # disabled
dom = ConstructDomain(DomainStart=number_slider, DomainEnd=number_slider_2)  # disabled
sdivide = DivideSurface(Surface=reparameterize(loft), UCount=number_slider_3, VCount=number_slider_4)  # -> Points, Normals, simplify(Parameters); disabled
image = ImageSampler(
    sdivide.Parameters,
    FilePath="C:\Users\Code 002\Desktop\DS_ProjectViz\Models\HumT\A2.jpg",
    Filter="Value",
    Interpolate=False,
    Umax=1,
    Umin=0,
    Vmax=1,
    Vmin=0,
    Wrap=1)  # disabled
image_data = Data(image)  # disabled
bnd = Bounds(Numbers=flatten(image_data))  # disabled
remap = RemapNumbers(Value=image_data, Source=bnd, Target=dom)  # -> Mapped, Clipped; disabled
circle = CircleCNR(Center=sdivide.Points, Normal=sdivide.Normals, Radius=remap.Mapped)  # disabled

# ----
# Panel
edge_ln_re_populated_2 = Data(edge_ln_re_populated)
crv = Curve(simplify(edge_ln_re_populated_2))
panel_z_pln_2 = Data(panel_z_pln)
plx = LinePlane(Line=graft(crv), Plane=panel_z_pln_2)  # -> simplify(graft(Point)), ParamL, ParamP
toggle = BooleanToggle(True)
fixed_data_panel = Panel("""{0;0}
{0;1}
{1;1}
{1;0}""")
relitem = RelativeItem(Tree=plx.Point, Offset=fixed_data_panel, WrapPaths=toggle, WrapItems=toggle)  # -> ItemA, ItemB
item_4 = ListItem(List=relitem.ItemB, Index=0, Wrap=True)  # -> Item, Item1, Item2, Item3
merge_2 = Merge(Data1=item_4.Item, Data2=item_4.Item1, Data3=item_4.Item2, Data4=item_4.Item3)
pline = PolyLine(Vertices=merge_2, Closed=True)  # -> simplify(Polyline)
lng = ListLength(List=panel_z_pln)  # -> expr("x-1", Length)
trim = TrimTree(Tree=pline, Depth=1)
gap = Slider(10, range=0..100)
split = SplitList(List=trim, Index=lng)  # -> simplify(ListA), simplify(flatten(ListB))
neg = Negative(Value=gap)
offset_l = OffsetCurveLoose(Curve=split.ListA, Distance=neg)
explode_2 = Explode(Curve=offset_l, Recursive=True)  # -> Segments, Vertices
explode_3 = Explode(Curve=split.ListB, Recursive=True)  # -> Segments, Vertices
item_5 = ListItem(List=explode_2.Vertices, Index=0, Wrap=True)  # -> Item, Item1, Item2, Item3
item_6 = ListItem(List=explode_3.Vertices, Index=0, Wrap=True)  # -> Item, Item1, Item2, Item3
srf4pt = _4PointSurface(CornerA=item_5.Item, CornerB=item_5.Item1, CornerC=item_5.Item2, CornerD=item_5.Item3)
srf4pt_2 = _4PointSurface(CornerA=item_6.Item, CornerB=item_6.Item1, CornerC=item_6.Item2, CornerD=item_6.Item3)  # -> simplify(flatten(Surface))
pshift = ShiftPaths(Data=srf4pt, Offset=-1)
panel_srf = Data(pshift)
panel_stack_srf = Data(srf4pt_2)

yz = YZPlane(Origin=Point(0, 0, 0))

# ----
# Orient Panel Ortho
# Initial Pln
# Adjust for rotation of Initial Pln
fixed_data_panel_2 = Panel("-90")
panel_stack_srf_2 = Data(simplify(graft(panel_stack_srf)))
pt_2 = ConstructPoint(XCoordinate=".5", YCoordinate=".5", ZCoordinate=0)
rad = Radians(Degrees=fixed_data_panel_2)
rotate = Rotate(Geometry=yz, Angle=rad, Plane=yz)  # -> Geometry, Transform
evalsrf = EvaluateSurface(Surface=reparameterize(panel_stack_srf_2), Point=pt_2)  # -> Point, Normal, UDirection, VDirection, Frame
panel_stack_srf_3 = Data(simplify(graft(panel_stack_srf)))
panel_srf_2 = Data(panel_srf)
orient = Orient(Geometry=panel_srf_2, Source=evalsrf.Frame, Target=rotate.Geometry)  # -> Geometry, Transform
orient_2 = Orient(Geometry=panel_stack_srf_3, Source=evalsrf.Frame, Target=rotate.Geometry)  # -> Geometry, Transform
panel_srf_ortho = Data(orient.Geometry)
panel_stack_srf_ortho = Data(orient_2.Geometry)

# ----
# Y Array Panel Ortho
panel_srf_ortho_2 = Data(panel_srf_ortho)
panel_stack_srf_ortho_2 = Data(panel_stack_srf_ortho)
bbox = BoundingBox(Content=panel_srf_ortho_2, Plane=PlaneXY(0, 0, 0), UnionBox=True)  # -> flatten(Box), Box_2
debox = DeconstructBox(Box=bbox.Box)  # -> Plane, X, Y, Z
dedomain = DeconstructDomain(Domain=debox.Y)  # -> Start, End
subtraction_2 = Subtraction(A=dedomain.End, B=dedomain.Start)
ma_3 = MassAddition(Input=subtraction_2)  # -> Result, PartialResults
shift = ShiftList(List=ma_3.PartialResults, Shift="-1", Wrap=Toggle(False))
ins = InsertItems(List=shift, Item="0", Indices="0", Wrap=True)
X = UnitX(Factor=Slider(26331, range=0..100000))
Y = UnitY(Factor=expr("-x", Slider(27857, range=0..100000)))
division_3 = Division(A=ma.Result, B=2)
Z = UnitZ(Factor=division_3)

Y_2 = UnitY(Factor=ins)  # -> simplify(graft(UnitVector))

move = Move(Geometry=panel_stack_srf_ortho_2, Motion=Y_2)  # -> Geometry, Transform
move_2 = Move(Geometry=panel_srf_ortho_2, Motion=Y_2)  # -> Geometry, Transform
panel_stack_srf_ortho_3 = Data(move.Geometry)
panel_srf_ortho_3 = Data(move_2.Geometry)
move_3 = Move(Geometry=panel_srf_ortho_3, Motion=X)  # -> Geometry, Transform
move_4 = Move(Geometry=move_3.Geometry, Motion=Y)  # -> Geometry, Transform
move_5 = Move(Geometry=move_4.Geometry, Motion=Z)  # -> Geometry, Transform

# ----
# Rotating UV of Surfaces Randomly Choosen for Texturing
all_panels_3d_unfolded = Data([move_5.Geometry, panel_srf])
flatten = FlattenTree(Tree=all_panels_3d_unfolded, Path="{0}")  # -> simplify(graft(Tree))
lng_2 = ListLength(List=flatten(flatten))
panel_3 = Panel("""0
1""")
repeat_2 = RepeatData(Data=panel_3, Length=lng_2)
item_7 = ListItem(List=flatten, Index=0, Wrap=True)  # -> Item, Item1, Item2
jitter = Jitter(List=repeat_2, Jitter=1, Seed=2)  # -> Values, Indices
dispatch = Dispatch(List=flatten(item_7.Item), DispatchPattern=jitter.Values)  # -> ListA, ListB
debrep = DeconstructBrep(Brep=dispatch.ListA)  # -> Faces, Edges, Vertices
item_8 = ListItem(List=debrep.Edges, Index=0, Wrap=True)  # -> Item, Item1, Item2, Item3
sumsrf = SumSurface(CurveA=item_8.Item3, CurveB=item_8.Item)  # -> flatten(Surface)
merge_3 = Merge(Data1=flatten(sumsrf), Data2=flatten(dispatch.ListB))  # -> simplify(graft(Result))
dispatched_flat_panels = Data(merge_3)

# ----
# Adding Thickness to All Panels
dispatched_flat_panels_2 = Data(dispatched_flat_panels)
evalsrf_2 = EvaluateSurface(Surface=reparameterize(dispatched_flat_panels_2), Point="0.5,0.5")  # -> Point, unitize(Normal), UDirection, VDirection, Frame
amp = Amplitude(Vector=evalsrf_2.Normal, Amplitude=Slider(50, range=0..1000))
move_6 = Move(Geometry=dispatched_flat_panels_2, Motion=amp)  # -> Geometry, Transform
crv_2 = Curve(dispatched_flat_panels_2)
crv_3 = Curve(move_6.Geometry)
merge_4 = Merge(Data1=crv_2, Data2=crv_3)
loft_2 = Loft(Curves=merge_4, Options={Adjust=False, Closed=False, LoftEnds=0, LoftSimp=0, LoftType=0, Rebuild=10, Refit=0.01})
merge_5 = Merge(Data1=dispatched_flat_panels_2, Data2=loft_2, Data3=move_6.Geometry)
custom_mesh_settings = SettingsCustom(
    StitchSeams=False,
    SimplePlanes=True,
    Refine=True,
    MinCount=Slider(1, range=0..100),
    MaxCount=Slider(1, range=0..100),
    AspectRatio=20,
    MaxDistance=0,
    MaxAngle=20,
    MinEdge=0,
    MaxEdge=0)
mesh = MeshBrep(Brep=merge_5, Settings=custom_mesh_settings)
mjoin = MeshJoin(Meshes=mesh)  # -> flatten(Mesh)

# ----
# Panels Without Thickness
flatten_2 = FlattenTree(Tree=all_panels_3d_unfolded, Path="{0}")  # -> simplify(Tree); disabled
number_slider_5 = Slider(1, range=0..100)  # disabled
number_slider_6 = Slider(1, range=0..100)  # disabled
custom_mesh_settings_2 = SettingsCustom(
    StitchSeams=False,
    SimplePlanes=True,
    Refine=True,
    MinCount=number_slider_5,
    MaxCount=number_slider_6,
    AspectRatio=20,
    MaxDistance=0,
    MaxAngle=20,
    MinEdge=0,
    MaxEdge=0)  # disabled
mesh_2 = MeshBrep(Brep=flatten_2, Settings=custom_mesh_settings_2)  # disabled
unim = UnifyMesh(Mesh=mesh_2)  # -> Result, Count; disabled

# ---- group: RH_OUT:GEO
mesh_3 = Mesh(mjoin)
